% Simulink data dictionary data_params.sldd

Sig = Simulink.Signal()
p = struct(temp_load_shedding_on=328)
Constant = struct(sigma=5.67e-8)
Area = struct(front=0.08, back=0.08, top=0.1, bottom=0.2, left=0.1, right=0.1, rad=0.1, solar_panel=0.1)
aligned_illum = [0.361032; 0.362125; 0.363222; 0.36434; 0.36544; 0.366543; 0.36766; 0.36876; 0.36986; 0.37097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 0.36711]
aligned_temp = [243.631947; 243.664395; 243.696795; 243.72897; 243.761204; 243.793475; 243.825759; 243.858093; 243.89036; 243.92268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 243.809048]
delta_lat = [-9e-06; -1e-05; -9e-06; -9e-06; -9e-06; -9e-06; -1e-05; -9e-06; -9e-06; -9e-06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 3e-06]
delta_lon = [0.015784; 0.015786; 0.015786; 0.015788; 0.015789; 0.01579; 0.015792; 0.015792; 0.015794; 0.015795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 -0.005676]
delta_x_meters = [2.063053; 2.06324; 2.063156; 2.063342; 2.063398; 2.063453; 2.063639; 2.063556; 2.063742; 2.063797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 -0.7421449]
delta_y_meters = [-0.27288; -0.3032; -0.27288; -0.27288; -0.27288; -0.27288; -0.3032; -0.27288; -0.27288; -0.27288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 0.09096]
distance_km = [0; 0.002082; 0.004165; 0.006247; 0.00833; 0.010412; 0.012494; 0.014577; 0.016659; 0.018742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 1.457677]
distance_m = [0; 2.082; 4.165; 6.247; 8.33; 10.412; 12.494; 14.577; 16.659; 18.742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 1457.677]
elevation_m = [902.34; 903.192817; 904.0012; 904.842559; 905.699816; 906.479404; 907.229131; 907.889625; 908.461094; 908.958149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 901.680017]
heading_rad = [1.702303; 1.716705; 1.702296; 1.702285; 1.702281; 1.702278; 1.716677; 1.702271; 1.70226; 1.702256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 -1.448841]
illum_dist_m = [0; 1; 2; 3; 4; 5; 6; 7; 8; 9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 683.996]
lat = [-89.753005; -89.753014; -89.753024; -89.753033; -89.753042; -89.753051; -89.75306; -89.75307; -89.753079; -89.753088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 -89.752915]
lon = [41.550532; 41.566316; 41.582102; 41.597888; 41.613676; 41.629465; 41.645255; 41.661047; 41.676839; 41.692633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 41.574009]
raw_illum = [0.361032; 0.362125; 0.363222; 0.36434; 0.36544; 0.366543; 0.36766; 0.36876; 0.36986; 0.37097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 0.36711]
raw_temp = [243.631947; 243.664395; 243.696795; 243.72897; 243.761204; 243.793475; 243.825759; 243.858093; 243.89036; 243.92268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 243.809048]
route_distance = [0; 2.082; 4.165; 6.247; 8.33; 10.412; 12.494; 14.577; 16.659; 18.742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 1457.677]
route_elevation = [902.34; 903.192817; 904.0012; 904.842559; 905.699816; 906.479404; 907.229131; 907.889625; 908.461094; 908.958149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 901.680017]
route_heading = [1.702303; 1.716705; 1.702296; 1.702285; 1.702281; 1.702278; 1.716677; 1.702271; 1.70226; 1.702256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 -1.448841]
route_illum = [0.38516; 0.38516; 0.38516; 0.38516; 0.38516; 0.38516; 0.38516; 0.38516; 0.38516; 0.38516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 0.38516]
route_max_dist = 1457.677
route_slope = [0.2156991; 0.2136228; 0.2127705; 0.2108081; 0.206767; 0.2076726; 0.2106082; 0.2115263; 0.2132293; 0.2158135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 0.2076518]
route_temp = [225.253693; 225.253693; 225.253693; 225.253693; 225.253693; 225.253693; 225.253693; 225.253693; 225.253693; 225.253693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 225.253693]
slope_degrees = [12.358649; 12.239684; 12.190849; 12.078417; 11.846879; 11.898765; 12.066959; 12.119566; 12.217138; 12.365205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 11.897574]
slope_radians = [0.2156991; 0.2136228; 0.2127705; 0.2108081; 0.206767; 0.2076726; 0.2106082; 0.2115263; 0.2132293; 0.2158135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 0.2076518]
temp_dist_m = [0; 1; 2; 3; 4; 5; 6; 7; 8; 9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 683.996]
u = [1.75 1.735628 1.721335 1.70712 1.692984 1.678926 1.664947 1.651046 1.637224 1.623481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 2.25]
x = [-2 -1.987469 -1.974937 -1.962406 -1.949875 -1.937343 -1.924812 -1.912281 -1.899749 -1.887218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 3]
xp = [-1 1 0 2]
yp = [1 1 0 1]

Cond = struct(
  area_core_chassis=0.0312,
  thick_core_chassis=0.0254,
  k_core_chassis=1.38,
  area_core_PCM=0.1656,
  thick_core_PCM=0.02,
  k_core_PCM=15,
  area_PCM_rad=0.1656,
  thick_PCM_rad=0.02,
  k_PCM_rad=15,
  area_chassis_PCM=0.00892,
  thick_chassis_PCM=0.02,
  k_chassis_PCM=1.38)

Spec = struct(
  alpha_rad=0.09,
  epsilon_rad=0.91,
  mass_rad_kg=1.8,
  cp_rad_J_kgK=896,
  mass_chassis_kg=11.3,
  cp_chassis_J_kgK=896,
  mass_electronics_kg=5.07,
  cp_electronics_J_kgK=830,
  alpha_mli=0.35,
  epsilon_mli=0.85,
  epsilon_eff_leak_mli=0.03,
  cp_mli_J_kgK=1170,
  mass_PCM=0.7,
  cp_PCM_J_kgK=1908,
  mass_cover=0.91,
  cp_cover=896,
  epsilon_back_cover=0.03,
  epsilon_front_cover=0.85,
  alpha_front_cover=0.91,
  solar_eff=0.3)

P = struct(
  driving_speed=0.75,
  mass_rover=17.37,
  temp_load_shedding_off=300,
  temp_load_shedding_on=302,
  power_avionics=22.95,
  gamma_start_sun=45,
  z_start_sun=89.5,
  power_digging=125.2,
  time_digging=30,
  power_load=6.98,
  power_unload=4.9,
  mass_PCM=0.7)

IC = struct(
  temp_core=301,
  temp_chassis=299,
  temp_rad=300,
  temp_PCM=300,
  power_motor=0.5,
  temp_MLI_front=242,
  temp_MLI_back=265,
  temp_MLI_top=220,
  temp_MLI_bottom=230,
  temp_MLI_right=272,
  temp_MLI_left=248)